vi "ConvertData.gviweb"   [LabVIEW NXG 5.0.0]
inputs:
  "RawData": string = """Vdd	V1	V2	V3	V4
1.760318 	 0.006863 	 0.474117 	 0.698897 	 0.890997 
1.253172 	 0.157272 	 0.524138 	 0.879478 	 0.199163 
1.610857 	 0.467745 	 0.142688 	 0.587099 	 0.283156 
3.026954 	 0.818327 	 1.247209 	 0.391501 	 1.975604 
0.127484 	 0.418980 	 0.803399 	 0.758553 	 0.405890 
2.610177 	 0.978176 	 1.135147 	 0.035014 	 1.451031 
4.540182 	 0.292695 	 1.335587 	 0.965694 	 1.730305 
4.932687 	 0.634877 	 0.554756 	 0.836532 	 0.842276 
0.489033 	 0.924692 	 1.310864 	 0.803888 	 1.154612 
2.352127 	 0.532247 	 1.388952 	 0.365325 	 1.019036 
1.945465 	 0.067415 	 0.235460 	 0.186740 	 1.486156 
4.345348 	 0.787688 	 1.966961 	 0.812985 	 0.024455 
0.971916 	 0.285933 	 1.741811 	 0.495521 	 1.172869 
2.544522 	 0.822699 	 1.542669 	 0.212272 	 1.240964 
2.115908 	 0.311029 	 0.455093 	 0.445414 	 0.594009 
1.365636 	 0.771988 	 1.995066 	 0.253665 	 1.793208 
4.258562 	 0.494554 	 0.693905 	 0.471052 	 0.189826 
2.997588 	 0.234534 	 1.895720 	 0.627280 	 0.207354 
0.575207 	 0.394134 	 0.163902 	 0.539993 	 0.820581 
2.168992 	 0.252456 	 0.916931 	 0.133988 	 1.725901 
1.602124 	 0.589458 	 1.528171 	 0.475245 	 0.971707 
3.510934 	 0.940529 	 1.456808 	 0.272417 	 1.708478 
0.459584 	 0.512264 	 0.268105 	 0.715052 	 0.140788 
3.693004 	 0.205217 	 0.321712 	 0.701205 	 1.495117 
0.713411 	 0.958305 	 0.932724 	 0.510902 	 0.098554 
2.411757 	 0.888134 	 0.889945 	 0.346217 	 1.467173 
1.670627 	 0.046710 	 0.378523 	 0.926803 	 1.356007 
0.975473 	 0.745348 	 0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
  "Error In": error
  "GraphRef": "Graph reference"[][]
outputs:
  "All Channels": f64[][]
  "Error Out": error
  "Data": string[][]
panel indicators:
  "Debub Header": string
  "Header": string[]
diagram:
  Match Pattern(regular expression="\\n", string=$RawData) -> (after substring=w1, before substring=w2)
  $"Debub Header" <- w2
  s1 = w2  # shift register
  while (iteration -> i1) {
    Match Pattern(regular expression="\\t", string=s1) -> (after substring=w4, before substring=w5, offset past match=w6)
    Property Node(instance in=$GraphRef, "ActivePlot"=i1) -> ("Plot"=w7)
    Property Node(instance in=w7, "Name"=w5)
    Is Less Than 0(x=w6) -> w8
    append w5 to w3
    next s1 = w4
    stop if w8
  }
  $Header <- w3
  s2 = w1  # shift register
  while {
    Match Pattern(regular expression="\\n", string=s2) -> (after substring=w11, before substring=w12, offset past match=w13)
    s3 = w12  # shift register
    while {
      Match Pattern(regular expression="\\t", string=s3) -> (after substring=w16, before substring=w17, offset past match=w18)
      Scan From String(inputString=w17) -> (out0=w19)
      Is Less Than 0(x=w18) -> w20
      append w17 to w14
      append w19 to w15
      next s3 = w16
      stop if w20
    }
    Is Less Than 0(x=w13) -> w21
    Not(x=w21) -> w22
    append w14 to w9 if w22
    append w15 to w10 if w22
    next s2 = w11
    stop if w21
  }
  Build Array(w3, w9) -> w23
  $Data <- w23
  Transpose 2D Array(2D array=w10) -> (transposed array=w24)
  $"All Channels" <- w24
  $"Error Out" <- $"Error In"
