vi "Index.gviweb"   [LabVIEW NXG 5.0.0]
panel controls:
  "Load Measurement Data from Skynet": bool
  "Paste Skylink and Load Data into the Viewer": string = "https://siasky.net/CAAjYi5kLZYyA-PAKmo3SkBS78zGee4FeQAUUm2EO-javA"
  "Control Reference": "Control reference"
  "Hyperlink Control": string = "https://siasky.net"
  "Clear Data": bool
  "Upload Text File": bool
  "Menu": i32
  "JavaScript Reference Terminal": "NI.JavaScriptReference"
  "Hyperlink Control_2": string = "https://github.com/cycleworm/dataviewer"
  "Hyperlink Control_3": string = "https://github.com/cycleworm/SiaSkynet-Macro"
panel indicators:
  "Data": f64[][]
  "Raw Data": string[][]
  "Upload Skylink:": string
  "URL Image_2": string
types:
  "Data.gtype" = cluster{"Data": "CartesianGraph reference", "Raw Data": "ArrayViewer reference"}
uses:
  App::Simlate_Delay.gviweb
  NI::HTTP::Open HTTP Handle.gvi
  NI::HTTP::GET.gvi
  App::ConvertData.gviweb
  NI::HTTP::Close HTTP Handle.gvi
  App::UpdatePlotLegend.gviweb
  UploadLib::UploadFileWebVI.jsli::OpenFileWebVI
  UploadLib::UploadFileWebVI.jsli::CheckIfDone
  UploadLib::UploadFileWebVI.jsli::ReadText
diagram:
  w1 = "Init"  # States
  s1 = w1  # shift register
  s2 = "Data.gtype" {all zero or empty}  # shift register
  while {
    case (s1) {
      frame "Init", Default {
        Property Node(instance in=s2, "Data"=reference to "Data", "Raw Data"=reference to "Raw Data") -> (instance out=w3)
        w4 = "Wait for Input"  # States
        w2 = w4
      }
      frame "Wait for Input" {
        event {
          on "Load Measurement Data from Skynet" Value changed {
            w5 = "Wait for Input"  # States
            w6 = 0  # Simulate Load Delay (ms)
            Set Busy(reference in=reference to unnamed front panel, error in=no error) -> (reference out=w7, error out=w8)
            call "Simlate_Delay.gviweb"(milliseconds to wait=w6, Error In=w8) -> (Error Out=w9)
            call "Open HTTP Handle.gvi"(error in=w9) -> (client handle out=w10, error out=w11)
            call "GET.gvi"(client handle=w10, url=$"Paste Skylink and Load Data into the Viewer", error in=w11) -> (client handle out=w12, body=w13, error out=w14)
            call "ConvertData.gviweb"(RawData=w13, Error In=w14) -> (All Channels=w15, Data=w16, Error Out=w17)
            $Data <- w15
            $"Raw Data" <- w16
            Reinitialize To Default(reference in="Control reference" constant)
            call "Close HTTP Handle.gvi"(client handle=w12, error in=w14)
            call "UpdatePlotLegend.gviweb"(GraphRef=reference to "Data", Raw Data IN=w13, Error In=w17) -> (Error Out=w18)
            Unset Busy(reference in=w7, error in=w18)
            w2 = w5
            w3 = s2
          }
          on "Clear Data" Value changed {
            w19 = "Wait for Input"  # States
            Property Node(instance in=reference to "Data", "Value"=f64[][] [])
            Property Node(instance in=reference to "Raw Data", "Value"=string[][] [])
            w2 = w19
            w3 = s2
          }
          on "Upload Text File" Value changed {
            call "OpenFileWebVI"() -> (error out=w20)
            while {
              Wait(time to wait=10)
              call "CheckIfDone"(error in=w20) -> (DoneReadingFile?=w21, error out=w22)
              stop if w21
            }
            call "ReadText"(error in=w22) -> (FileText=w23)
            $"Upload Skylink:" <- w23
            w2 = default
            w3 = default
          }
        }
      }
    }
    next s1 = w2
    next s2 = w3
    stop if FALSE
  }
