vi "UpdatePlotLegend.gviweb"   [LabVIEW NXG 5.0.0]
inputs:
  "GraphRef": "Graph reference"[][]
  "Raw Data IN": string
  "Error In": error
outputs:
  "Error Out": error
diagram:
  Match Pattern(regular expression="\\n", string=$"Raw Data IN") -> (before substring=w1)
  s1 = w1  # shift register
  while (iteration -> i1) {
    Wait(time to wait=10)
    Match Pattern(regular expression="\\t", string=s1) -> (after substring=w2, before substring=w3, offset past match=w4)
    Property Node(instance in=$GraphRef, "ActivePlot"=i1) -> ("Plot"=w5)
    Property Node(instance in=w5, "Name"=w3)
    Is Less Than 0(x=w4) -> w6
    next s1 = w2
    stop if w6
  }
  $"Error Out" <- $"Error In"
